# Grasshopper definition A2.gh (Grasshopper 1.0.7)

# Connector Shape & Size Controls
thickness_of_cutout = Slider(1.371, range=0..100)
depth_of_cutout = Slider(6, range=0..100)
number_of_slots = Slider(2, range=0..20)
circle_radius = Slider(12.7, range=0..100)
angle_of_cutout_slots = Slider(233.13, range=0..720)
# Connection Piece
point = Point(Point(0, 50, 0))
# Polygon Shape & Size Controls
size_of_polygon = Slider(21, range=0..100)
thickess_of_cutout = Slider(1.371, range=0..10)
of_sides = Slider(5, range=0..20)
depth_of_cutout_2 = Slider(6.35, range=0..10)
# Polygon
point_2 = Point(Point(0, 0, 0))
radians = Radians(Degrees=angle_of_cutout_slots)
number = Number(-2)
subtraction = Subtraction(A=circle_radius, B=depth_of_cutout)
polygon = Polygon(Plane=point_2, Radius=size_of_polygon, Segments=of_sides, FilletRadius=0)  # -> Polygon, Length
division = Division(A=thickness_of_cutout, B=number)
rectangle = Rectangle(Plane=point, XSize=thickness_of_cutout, YSize=depth_of_cutout, Radius=0)  # -> Rectangle, Length
addition = Addition(A=depth_of_cutout_2, B=Slider(1, range=0..1))
vector_xyz = VectorXYZ(XComponent=division, YComponent=subtraction, ZComponent=0)  # -> Vector, Length
deconstruct_brep = DeconstructBrep(Brep=polygon.Polygon)  # -> Faces, Edges, Vertices
length = Length(Curve=deconstruct_brep.Edges)
curve_middle = CurveMiddle(Curve=deconstruct_brep.Edges)
move = Move(Geometry=rectangle.Rectangle, Motion=vector_xyz.Vector)  # -> Geometry, Transform
curve = Curve(deconstruct_brep.Edges)
division_2 = Division(A=thickess_of_cutout, B=length)
boolean_toggle = BooleanToggle(True)
vector_2pt = Vector2Pt(PointA=point_2, PointB=curve_middle, Unitize=boolean_toggle)  # -> Vector, Length
vector_2pt_2 = Vector2Pt(PointA=curve_middle, PointB=point_2, Unitize=boolean_toggle)  # -> Vector, Length
polar_array = PolarArray(Geometry=move.Geometry, Plane=point, Count=number_of_slots, Angle=radians)  # -> Geometry, Transform
scale = Scale(Geometry=curve, Center=curve_middle, Factor=division_2)  # -> Geometry, Transform
circle = Circle(Plane=point, Radius=circle_radius)
amplitude = Amplitude(Vector=vector_2pt_2.Vector, Amplitude=addition)
extrude = Extrude(Base=scale.Geometry, Direction=amplitude)
trim_with_regions = TrimWithRegions(Curve=polar_array.Geometry, Regions=circle)  # -> flatten(Inside), Outside
trim_with_regions_2 = TrimWithRegions(Curve=circle, Regions=polar_array.Geometry)  # -> Inside, flatten(Outside)
move_2 = Move(Geometry=extrude, Motion=vector_2pt.Vector)  # -> Geometry, Transform
join_curves = JoinCurves(Curves=[trim_with_regions.Inside, trim_with_regions_2.Outside], Preserve=False)
trim_with_regions_3 = TrimWithRegions(Curve=move_2.Geometry, Regions=deconstruct_brep.Faces)  # -> Inside, Outside
trim_with_regions_4 = TrimWithRegions(Curve=deconstruct_brep.Faces, Regions=move_2.Geometry)  # -> Inside, Outside
curve_2 = Curve(flatten(trim_with_regions_4.Outside))
curve_3 = Curve(flatten(trim_with_regions_3.Inside))
join_curves_2 = JoinCurves(Curves=[curve_2, curve_3], Preserve=False)
