# Grasshopper definition Diamond candle.gh (Grasshopper 1.0.7)
# plug-ins: LunchBox, Weaverbird, MeshEdit Components

height = Slider(125, range=0..200)
steps = Slider(12, range=0..20)
top_radius = Slider(25, range=0..100)
base_radius = Slider(25, range=0..100)
range = Range(Domain=Domain(0, 1), Steps=steps)
graph_mapper = GraphMapper(
    x0=0,
    x1=1,
    y0=0,
    y1=1,
    container_name="Bezier",
    cpx=[0, 0.6691486835, 0.5263677239, 1],
    cpy=[0, 0.003063678741, 0.1993954182, 1])  # disabled
graph_mapper_2 = GraphMapper(
    range,
    x0=0,
    x1=1,
    y0=0,
    y1=1,
    container_name="Bezier",
    cpx=[0, 0.6691486835, 0.5263677239, 1],
    cpy=[0, 0.003063678741, 0.1993954182, 1])
construct_domain = ConstructDomain(DomainStart=base_radius, DomainEnd=top_radius)
range_2 = Range(Domain=height, Steps=steps)
remap_numbers = RemapNumbers(Value=graph_mapper_2, Source=Domain(0, 1), Target=construct_domain)  # -> Mapped, Clipped
numbers_to_points = NumbersToPoints(Numbers=range_2, Mask="z")
circle = Circle(Plane=numbers_to_points, Radius=remap_numbers.Mapped)
panel = Panel("""0
-1""")
u_divisions = Slider(10, range=0..50)
v_divisions = Slider(18, range=0..50)
loft = Loft(Curves=circle, Options={Adjust=False, Closed=False, LoftEnds=0, LoftSimp=0, LoftType=0, Rebuild=10, Refit=0.01})
list_item = ListItem(List=circle, Index=panel, Wrap=True)
lunchbox_braced_grid_2_d_structure = BracedGrid2DStructure(Surface=loft, UDivisions=u_divisions, VDivisions=v_divisions)  # -> PrimaryLines, BraceLines, StructureNodes
surface = Surface(loft)
curve = Curve(lunchbox_braced_grid_2_d_structure.BraceLines)
end_points = EndPoints(Curve=curve)  # -> Start, End
cull_duplicates = CullDuplicates(Points=[end_points.Start, end_points.End], Tolerance=0.1, CullMode=3)  # -> Points, Indices, Valence
curve_closest_point = CurveClosestPoint(Point=cull_duplicates.Points, Curve=graft(list_item))  # -> Point, Parameter, Distance
smaller_than = SmallerThan(FirstNumber=curve_closest_point.Distance, SecondNumber="0.01")  # -> SmallerThan, OrEqualTo
cull_pattern = CullPattern(List=cull_duplicates.Points, CullPattern=smaller_than.SmallerThan)
polyline = PolyLine(Vertices=cull_pattern, Closed=invert(False))
explode = Explode(Curve=polyline, Recursive=True)  # -> Segments, Vertices
merge = Merge(Data1=explode.Segments, Data2=curve)  # -> flatten(Result)
weaverbird_s_mesh_from_lines_weave_back = WeaverbirdsMeshFromLinesWeaveBack(Lines=merge, MaximumValence=4)
face_boundaries = FaceBoundaries(Mesh=weaverbird_s_mesh_from_lines_weave_back)
polygon_center = PolygonCenter(Polyline=face_boundaries)  # -> CenterV, CenterE, CenterA
surface_closest_point = SurfaceClosestPoint(Point=polygon_center.CenterV, Surface=surface)  # -> Point, UVPoint, Distance
deconstruct = Deconstruct(Point=polygon_center.CenterV)  # -> XComponent, YComponent, ZComponent
evaluate_surface = EvaluateSurface(Surface=surface, Point=surface_closest_point.UVPoint)  # -> Point, Normal, UDirection, VDirection, Frame
sort_list = SortList(
    Keys=deconstruct.ZComponent,
    ValuesValuesA=evaluate_surface.Normal,
    ValuesB=polygon_center.CenterV,
    ValuesC=face_boundaries)  # -> Keys, ValuesValuesA, ValuesB, ValuesC
list_length = ListLength(List=sort_list.Keys)
deconstruct_vector = DeconstructVector(Vector=evaluate_surface.Normal)  # -> XComponent, YComponent, ZComponent
range_3 = Range(Domain=Domain(0, 1), Steps=expr("x-1", list_length))
protrusion = Slider(5, range=0..10)
graph_mapper_3 = GraphMapper(
    range_3,
    x0=0,
    x1=1,
    y0=0,
    y1=1,
    container_name="Bezier",
    cpx=[0, 0.06877301633, 0.4914146364, 1],
    cpy=[1, 0.6766066551, 0.9969355464, 0])
multiplication = Multiplication(A=graph_mapper_3, B=protrusion)
amplitude = Amplitude(Vector=sort_list.ValuesValuesA, Amplitude=multiplication)
reverse = Reverse(Vector=amplitude)
move = Move(Geometry=sort_list.ValuesB, Motion=reverse)  # -> Geometry, Transform
extrude_point = ExtrudePoint(Base=sort_list.ValuesC, Point=move.Geometry)
simple_mesh = SimpleMesh(Brep=extrude_point)
mesh_join = MeshJoin(Meshes=simple_mesh)
panel_2 = Panel(mesh_join)
wall_thickness = Slider(0, range=0..2)
mesh_weldvertices = MeshWeldVertices(Mesh=mesh_join, Tolerance=0.01)  # -> RuntimeMessage, Mesh
panel_3 = Panel(mesh_weldvertices.Mesh)
weaverbird_s_mesh_thicken = WeaverbirdsMeshThicken(MeshCurves=mesh_weldvertices.Mesh, Distance=wall_thickness, OffsetType=0)
weaverbird_s_split_triangles_subdivision = WeaverbirdsSplitTrianglesSubdivision(MeshCurves=weaverbird_s_mesh_thicken, Level="2")
weaverbird_s_loop_subdivision = WeaverbirdsLoopSubdivision(MeshCurves=weaverbird_s_split_triangles_subdivision, Level="2", SmoothNakedEdges=1)  # disabled
