# Grasshopper definition curvy candle.gh (Grasshopper 1.0.7)

steps = Slider(10, range=0..20)
# Curvy Candle
# 
# Modify the height, steps, start, end, or graph to change the curve design.
height = Slider(140, range=0..200)
start = Slider(29, range=0..50)
end = Slider(15, range=0..30)
# Curvy Candle Process
# 
# Previous version/exploration. Preview hidden.
steps_2 = Slider(16, range=0..100)
count = Slider(10, range=0..100)
range = Range(Domain=Domain(0, 1), Steps=steps)
graph_mapper = GraphMapper(x0=0, x1=1, y0=0, y1=1, container_name="Sine", Equation_px=[0.8492802978, 1], Equation_py=[0, 1])
graph_mapper_2 = GraphMapper(
    range,
    x0=0,
    x1=1,
    y0=0,
    y1=1,
    container_name="Sine",
    Equation_px=[0.8523245454, 1],
    Equation_py=[0.430020988, 0.9957452416])
series = Series(Start=0, Step=steps_2, Count=count)
construct_domain = ConstructDomain(DomainStart=start, DomainEnd=end)
range_2 = Range(Domain=height, Steps=10)
merge = Merge(
    Data1=Slider(20, range=0..100),
    Data2=Slider(29, range=0..100),
    Data3=Slider(15, range=0..100),
    Data4=Slider(29, range=0..100),
    Data5=Slider(15, range=0..100),
    Data6=Slider(29, range=0..100),
    Data7=Slider(17, range=0..100),
    Data8=Slider(29, range=0..100),
    Data9=Slider(15, range=0..100))
numbers_to_points = NumbersToPoints(Numbers=series, Mask="z")
remap_numbers = RemapNumbers(Value=graph_mapper_2, Source=Domain(0, 1), Target=construct_domain)  # -> Mapped, Clipped
numbers_to_points_2 = NumbersToPoints(Numbers=range_2, Mask="z")
circle = Circle(Plane=numbers_to_points, Radius=merge)
circle_2 = Circle(Plane=numbers_to_points_2, Radius=remap_numbers.Mapped)
loft = Loft(Curves=circle, Options={Adjust=False, Closed=False, LoftEnds=0, LoftSimp=0, LoftType=0, Rebuild=10, Refit=0.01})
loft_2 = Loft(Curves=circle_2, Options={Adjust=False, Closed=False, LoftEnds=0, LoftSimp=0, LoftType=0, Rebuild=10, Refit=0.01})
cap_holes = CapHoles(Brep=loft)
cap_holes_2 = CapHoles(Brep=loft_2)
