# Grasshopper definition folded candle.gh (Grasshopper 1.0.7)
# plug-ins: LunchBox

radius = Slider(25, range=0..100)
height = Slider(96, range=0..200)
# This is from watching the YouTube tutorial
xy_plane = XYPlane(Origin=Point(0, 0, 0))
radius_2 = Slider(25, range=0..100)
height_2 = Slider(96, range=0..200)
panel = Panel("folds with curves")
# This is my simplified version
xy_plane_2 = XYPlane(Origin=Point(0, 0, 0))
vertical_divisions = Slider(20, range=0..100)
horizontal_divisions = Slider(16, range=0..100)
unit_z = UnitZ(Factor=height)
circle = Circle(Plane=xy_plane, Radius=radius)
vertical_divisions_2 = Slider(20, range=0..100)
horizontal_divisions_2 = Slider(16, range=0..100)
unit_z_2 = UnitZ(Factor=height_2)
circle_2 = Circle(Plane=xy_plane_2, Radius=radius_2)
construct_domain = ConstructDomain(DomainStart=Slider(30, range=0..50), DomainEnd=Slider(18, range=0..50))
range = Range(Domain=Slider(140, range=0..200), Steps=10)
range_2 = Range(Domain=Domain(0, 1), Steps=Slider(8, range=0..20))
extrude = Extrude(Base=circle, Direction=unit_z)
extrude_2 = Extrude(Base=circle_2, Direction=unit_z_2)
triangle_panels_b = TrianglePanelsB(Surface=extrude, UDivisions=vertical_divisions, VDivisions=horizontal_divisions)
brep_edges = BrepEdges(Brep=extrude)  # -> Naked, Interior, NonManifold
remap_numbers = RemapNumbers(Value=range_2, Source=Domain(0, 1), Target=construct_domain)  # -> Mapped, Clipped
triangle_panels_b_2 = TrianglePanelsB(Surface=extrude_2, UDivisions=vertical_divisions_2, VDivisions=horizontal_divisions_2)
numbers_to_points = NumbersToPoints(Numbers=range, Mask="z")
area = Area(Geometry=triangle_panels_b)  # -> Area, Centroid
curve = Curve(brep_edges.Interior)
vertical_divisions_3 = Slider(11, range=0..100)
boundary_surfaces = BoundarySurfaces(Edges=triangle_panels_b_2)
circle_3 = Circle(Plane=numbers_to_points, Radius=remap_numbers.Mapped)
horizontal_divisions_3 = Slider(12, range=0..100)
curve_closest_point = CurveClosestPoint(Point=area.Centroid, Curve=brep_edges.Interior)  # -> Point, Parameter, Distance
divide_curve = DivideCurve(Curve=curve, Count=vertical_divisions, Kinks=False)  # -> Points, Tangents, Parameters
loft = Loft(Curves=circle_3, Options={Adjust=False, Closed=False, LoftEnds=0, LoftSimp=0, LoftType=0, Rebuild=10, Refit=0.01})
brep_join = BrepJoin(Breps=boundary_surfaces)  # -> Breps, Closed
sort_list = SortList(Keys=curve_closest_point.Distance)  # -> Keys, ValuesA
triangle_panels_b_3 = TrianglePanelsB(Surface=loft, UDivisions=vertical_divisions_3, VDivisions=horizontal_divisions_3)
cap_holes = CapHoles(Brep=brep_join.Breps)
list_item = ListItem(List=sort_list.Keys, Index=0, Wrap=True)
boundary_surfaces_2 = BoundarySurfaces(Edges=triangle_panels_b_3)
addition = Addition(A=list_item, B="0.1")
brep_join_2 = BrepJoin(Breps=boundary_surfaces_2)  # -> Breps, Closed
panel_2 = Panel("""false
true""")
smaller_than = SmallerThan(FirstNumber=curve_closest_point.Distance, SecondNumber=addition)  # -> SmallerThan, OrEqualTo
cap_holes_2 = CapHoles(Brep=brep_join_2.Breps)
cull_pattern = CullPattern(List=divide_curve.Points, CullPattern=panel_2)
dispatch = Dispatch(List=triangle_panels_b, DispatchPattern=smaller_than.SmallerThan)  # -> ListA, ListB
surface = Surface(dispatch.ListA)
partition_list = PartitionList(List=dispatch.ListA, Size="2")
brep_join_3 = BrepJoin(Breps=partition_list)  # -> flatten(Breps), Closed
discontinuity = Discontinuity(Curve=brep_join_3.Breps, Level=1)  # -> Points, Parameters
pull_point = PullPoint(Point=discontinuity.Points, Geometry=cull_pattern, ClosestOnly=True)  # -> ClosestPoint, Distance
larger_than = LargerThan(FirstNumber=pull_point.Distance, SecondNumber=".1")  # -> LargerThan, OrEqualTo
cull_pattern_2 = CullPattern(List=discontinuity.Points, CullPattern=larger_than.LargerThan)
polyline = PolyLine(Vertices=cull_pattern_2, Closed=invert(False))
boundary_surfaces_3 = BoundarySurfaces(Edges=polyline)
surface_2 = Surface(dispatch.ListB)
brep_join_4 = BrepJoin(Breps=flatten([boundary_surfaces_3, surface_2]))  # -> Breps, Closed
cap_holes_3 = CapHoles(Brep=brep_join_4.Breps)
