# Grasshopper definition printing blocks.gh (Grasshopper 1.0.7)
# plug-ins: PTComponentLibrary

length = Slider(165, range=0..300)
points = Slider(60, range=0..100)
frequency = Slider(8, range=0..100)
height = Slider(7, range=0..15)
thickness = Slider(2.5, range=0..5)
distance_btwn_objects = Slider(0.84, range=0..2)
blob_curve_degree = Slider(6, range=0..30)
offset = Slider(-5, range=-20..20)
count = Slider(18, range=0..200)
panel = Panel("Basic Shapes")
height_2 = Slider(92, range=0..500)
# Voronoi Blobs
# 
# (hidden - show preview to bake)
width = Slider(300, range=0..500)
radius = Slider(30, range=0..100)
panel_2 = Panel("Curved Lines")
offset_2 = Slider(-5, range=-20..20)
u_number = Slider(8, range=0..30)
v_number = Slider(9, range=0..30)
shape_radius = Slider(6, range=0..30)
height_3 = Slider(54, range=0..500)
width_2 = Slider(100, range=0..500)
u_number_2 = Slider(8, range=0..30)
u_number_3 = Slider(10, range=0..30)
polygon_sides = Slider(6, range=0..12)
fillet_radius = Slider(0, range=0..12)
segments = Slider(3, range=3..15)
offset_3 = Slider(-5, range=-20..20)
v_number_2 = Slider(3, range=0..30)
offset_4 = Slider(-5, range=-20..20)
v_number_3 = Slider(7, range=0..30)
height_4 = Slider(40, range=0..500)
shape_radius_2 = Slider(3, range=0..30)
height_5 = Slider(70, range=0..500)
shape_radius_3 = Slider(3, range=0..30)
fillet_radius_2 = Slider(4, range=1..15)
# Pattern Blocks for Subtractive Mfg
width_3 = Slider(100, range=0..500)
width_4 = Slider(100, range=0..500)
radius_2 = Slider(16, range=0..100)
pi = Pi(Factor=frequency)
rectangle = Rectangle(Plane=PlaneXY(0, 0, 0), XSize=width, YSize=height_2, Radius=0)  # -> Rectangle, Length
rectangle_2 = Rectangle(Plane=PlaneXY(0, 0, 0), XSize=width_2, YSize=height_3, Radius=0)  # -> Rectangle, Length
rectangle_3 = Rectangle(Plane=PlaneXY(0, 0, 0), XSize=width_4, YSize=height_5, Radius=0)  # -> Rectangle, Length
rectangle_4 = Rectangle(Plane=PlaneXY(0, 0, 0), XSize=width_3, YSize=height_4, Radius=0)  # -> Rectangle, Length
polygon = Polygon(Plane=PlaneXY(0, 0, 0), Radius=radius_2, Segments=segments, FilletRadius=fillet_radius_2)  # -> Polygon, Length
circle = Circle(Plane=PlaneXY(0, 0, 0), Radius=radius)
v_number_4 = Slider(2, range=0..30)
width_5 = Slider(90, range=0..500)
range = Range(Domain=length, Steps=points)
range_2 = Range(Domain=pi, Steps=points)
offset_curve = OffsetCurve(Curve=rectangle.Rectangle, Distance=offset, Corners=1)
offset_curve_2 = OffsetCurve(Curve=rectangle_2.Rectangle, Distance=offset_2, Corners=1)
offset_curve_3 = OffsetCurve(Curve=rectangle_3.Rectangle, Distance=offset_4, Corners=1)
offset_curve_4 = OffsetCurve(Curve=rectangle_4.Rectangle, Distance=offset_3, Corners=1)
v_number_5 = Slider(5, range=0..30)
boundary_surfaces = BoundarySurfaces(Edges=offset_curve)
boundary_surfaces_2 = BoundarySurfaces(Edges=offset_curve_2)
boundary_surfaces_3 = BoundarySurfaces(Edges=offset_curve_4)
boundary_surfaces_4 = BoundarySurfaces(Edges=offset_curve_3)
v_number_6 = Slider(1, range=0..30)
v_number_7 = Slider(6, range=0..30)
expression = Expression(x=range, y=range_2, r=height, Expression="{x, cos(y)*r, 0}")
unit_y = UnitY(Factor=v_number_5)
rectangle_5 = Rectangle(Plane=PlaneXY(0, 0, 0), XSize=width_5, YSize=v_number_4, Radius=0)  # -> Rectangle, Length
surface_domain_length = SurfaceDomainLength(Surface=boundary_surfaces_2, ULength=u_number, VLength=v_number)
populate_2d = Populate2D(Region=boundary_surfaces, Count=count, Seed=1)
surface_domain_number = SurfaceDomainNumber(Surface=boundary_surfaces_4, UNumber=u_number_3, VNumber=v_number_3)
surface_domain_number_2 = SurfaceDomainNumber(Surface=boundary_surfaces_3, UNumber=u_number_2, VNumber=v_number_2)
interpolate = Interpolate(Vertices=expression, Degree=3, Periodic=False, KnotStyle=1)  # -> Curve, Length, Domain
linear_array = LinearArray(Geometry=rectangle_5.Rectangle, Direction=unit_y, Count=v_number_7)  # -> Geometry, Transform
voronoi = Voronoi(Points=populate_2d, Boundary=boundary_surfaces, BruteForceOverride=False)
rectangle_6 = Rectangle(Plane=PlaneXY(0, 0, 0), XSize=Domain(-1, 1), YSize=v_number_6, Radius=0)  # -> Rectangle, Length
curve = Curve(interpolate.Curve)
polygon_2 = Polygon(Plane=surface_domain_number, Radius=shape_radius_3, Segments=polygon_sides, FilletRadius=fillet_radius)  # -> Polygon, Length
circle_2 = Circle(Plane=surface_domain_number_2, Radius=shape_radius_2)
polygon_center = PolygonCenter(Polyline=voronoi)  # -> CenterV, CenterE, CenterA
group = Group(Objects=linear_array.Geometry)
offset_curve_5 = OffsetCurve(Curve=curve, Distance=thickness, Corners=1)
scale = Scale(Geometry=voronoi, Center=polygon_center.CenterA, Factor=distance_btwn_objects)  # -> Geometry, Transform
group_2 = Group(Objects=[rectangle_3.Rectangle, polygon_2.Polygon])
group_3 = Group(Objects=[circle_2, rectangle_4.Rectangle])
end_points = EndPoints(Curve=curve)  # -> Start, End
end_points_2 = EndPoints(Curve=offset_curve_5)  # -> Start, End
rebuild_curve = RebuildCurve(Curve=scale.Geometry, Degree=blob_curve_degree, Count=10, Tangents=False)
line = Line(StartPoint=end_points.End, EndPoint=end_points_2.End)
line_2 = Line(StartPoint=end_points.Start, EndPoint=end_points_2.Start)
join_curves = JoinCurves(Curves=[line, line_2, offset_curve_5, interpolate.Curve], Preserve=False)
